# Grasshopper definition layoutTesting.gh (Grasshopper 1.0.7)
# plug-ins: GenerativeBuilding, ProvingGround.Conduit

leg_1 = Slider(1, range=0..1)
leg3 = Slider(1, range=0..1)
leg2 = Slider(1, range=0..1)
corridorwidth = Slider(9, range=0..100)
unitdepth = Slider(27, range=0..100)
numstories = Slider(3, range=1..5)
storyheight = Slider(10, range=0..10)
main = Slider(1, range=0..1)
multiplication = Multiplication(A=Slider(120, range=0..120), B=3)
multiplication_2 = Multiplication(A=Slider(120, range=0..120), B=3)
multiplication_3 = Multiplication(A=multiplication_2, B=12)
multiplication_4 = Multiplication(A=multiplication, B=12)
c_script = CSharpScript(x=leg_1)  # -> out, A; inputs x: Double
# ---------- c_script: C# ----------
    if(x < 0.3){
      A = 0;
    }
    else
    {
      A = x; 
    }
# ---------- end c_script ----------
c_script_2 = CSharpScript(x=leg2)  # -> out, A; inputs x: Double; same code as c_script
c_script_3 = CSharpScript(x=leg3)  # -> out, A; inputs x: Double; same code as c_script
multiplication_5 = Multiplication(A=unitdepth, B=12)
multiplication_6 = Multiplication(A=multiplication_5, B=2)
multiplication_7 = Multiplication(A=corridorwidth, B=12)
addition = Addition(A=multiplication_6, B=multiplication_7)
multiplication_8 = Multiplication(A=numstories, B=storyheight)
rectangle = Rectangle(Plane=PlaneXY(0, 0, 0), XSize=multiplication_4, YSize=multiplication_3, Radius=0)  # -> Rectangle, Length
crv = Curve(rectangle.Rectangle)
cp = ControlPoints(Curve=crv)  # -> Points, Weights, Knots
item = ListItem(List=cp.Points, Index=0, Wrap=True)

multiplication_9 = Multiplication(A=multiplication_5, B=2)
subtraction = Subtraction(A=multiplication_4, B=multiplication_9)
multiplication_10 = Multiplication(A=subtraction, B=main)
vec = VectorXYZ(XComponent=multiplication_5, YComponent=multiplication_5, ZComponent=0)  # -> Vector, Length
X = UnitX(Factor=multiplication_10)
move = Move(Geometry=item, Motion=vec.Vector)  # -> Geometry, Transform
move_2 = Move(Geometry=move.Geometry, Motion=X)  # -> Geometry, Transform
ln = Line(StartPoint=move.Geometry, EndPoint=move_2.Geometry)

division = Division(A=multiplication_7, B=2)
addition_2 = Addition(A=multiplication_5, B=division)
ext = ExtendCurve(Curve=ln, Type=0, Start=addition_2, End=addition_2)
division_2 = Division(A=multiplication_7, B=2)
neg = Negative(Value=division_2)
len = Length(Curve=ln)
c_script_4 = CSharpScript(height=multiplication_8, width=addition, primaryLength=len, legTwoRatio=c_script_2.A, legThreeRatio=c_script_3.A)  # -> legTwo, legThree; inputs height: Double, width: Double, primaryLength: Double
# ---------- c_script_4: C# ----------
    if((primaryLength - width) > height)
    {
      legThree = legThreeRatio;
    }
    else
    {
      legThree = 0;
    }

    if(primaryLength - 2 * width > height)
    {
      legTwo = legTwoRatio;
    }
    else
    {
      legTwo = 0;
    }
# ---------- end c_script_4 ----------
merge = Merge(Data1=division_2, Data2=neg)
panel = Panel("""40,40,40
70,70,70
110,110,110
150,150,150""")
panel_2 = Panel("""S
A
B
C""")
dom = ConstructDomain(DomainStart=0, DomainEnd=100)
palette = ConduitColorPalette(
    Seed=3,
    HueRange=Domain(-0.05, 0.05),
    SaturationRange=Domain(-0.15, 0.15),
    LuminanceRange=Domain(-0.1, 0.1),
    BaseColors=panel)
path = FilePath("C:\dev\dbei-hackathon-na-2019\extern\unitMix.csv")
rec = Rectangle({Plane=PlaneXY(15056.42054, -871.962077, 0), Size=Domain2(u=-4286.425078..4286.425078, v=-4508.13672..4508.13672)})
path_2 = FilePath("C:\dev\dbei-hackathon-na-2019\extern\units.csv")
rec_2 = Rectangle({Plane=PlaneXY(9705.779584, 3976.132494, 0), Size=Domain2(u=-11203.82831..11203.82831, v=-9888.339231..9888.339231)})
col = Colour(RGB(122, 118, 255))
panel_3 = Panel(col)

subtraction_2 = Subtraction(A=multiplication_3, B=multiplication_9)
multiplication_11 = Multiplication(A=subtraction_2, B=c_script.A)

multiplication_12 = Multiplication(A=subtraction_2, B=c_script_4.legThree)
Y = UnitY(Factor=multiplication_12)
len_2 = Length(Curve=ln)
X_2 = UnitX(Factor=len_2)
move_3 = Move(Geometry=move.Geometry, Motion=Y)  # -> Geometry, Transform
move_4 = Move(Geometry=move_3.Geometry, Motion=X_2)  # -> Geometry, Transform
move_5 = Move(Geometry=move.Geometry, Motion=X_2)  # -> Geometry, Transform
ln_2 = Line(StartPoint=move_5.Geometry, EndPoint=move_4.Geometry)

division_3 = Division(A=multiplication_11, B=3)
division_4 = Division(A=multiplication_12, B=3)
int = Integer(division_3)
int_2 = Integer(division_4)
multiplication_13 = Multiplication(A=int, B=3)
multiplication_14 = Multiplication(A=int_2, B=3)

Y_2 = UnitY(Factor=multiplication_13)
move_6 = Move(Geometry=move.Geometry, Motion=Y_2)  # -> Geometry, Transform
ln_3 = Line(StartPoint=move.Geometry, EndPoint=move_6.Geometry)

multiplication_15 = Multiplication(A=subtraction_2, B=c_script_4.legTwo)
len_3 = Length(Curve=ln)
division_5 = Division(A=len_3, B=2)
X_3 = UnitX(Factor=division_5)
move_7 = Move(Geometry=move.Geometry, Motion=X_3)  # -> Geometry, Transform

division_6 = Division(A=multiplication_15, B=3)
int_3 = Integer(division_6)
multiplication_16 = Multiplication(A=int_3, B=3)

Y_3 = UnitY(Factor=multiplication_16)
move_8 = Move(Geometry=move.Geometry, Motion=Y_3)  # -> Geometry, Transform
move_9 = Move(Geometry=move_8.Geometry, Motion=X_3)  # -> Geometry, Transform
ln_4 = Line(StartPoint=move_7.Geometry, EndPoint=move_9.Geometry)

merge_2 = Merge(Data1=ln, Data2=ln_3, Data3=ln_4, Data4=ln_2)
c_script_5 = CSharpScript(x=merge_2)  # -> A; inputs x: Line
# ---------- c_script_5: C# ----------
    if(x.Length!=0)
    {
      A = x;
    }
# ---------- end c_script_5 ----------
clean = CleanTree(RemoveNulls=True, RemoveInvalid=True, RemoveEmpty=False, Tree=c_script_5)
offset = OffsetCurve(Curve=clean, Distance=simplify(graft(merge)), Plane=PlaneXY(0, 0, 0), Corners=1)  # -> simplify(Curve)
generativebuilding = GenerativeBuilding(
    UnitDefCSV=path_2,
    UnitMixCSV=path,
    MainCorridor=ext,
    LeftCorridor=ln_3,
    MiddleCorridor=ln_4,
    RightCorridor=ln_2,
    UnitDepth=multiplication_5,
    HallWidth=multiplication_7)  # -> Units, CorridorLines, UnitNames, ShearWallLines, Outline, PercentMix
c_script_6 = CSharpScript(x=generativebuilding.PercentMix)  # -> out, A; inputs x: Double
# ---------- c_script_6: C# ----------
    A = Math.Round(x * 100, 0);
# ---------- end c_script_6 ----------
concat = Concatenate(FragmentA=panel_2, FragmentC=" ", FragmentB=c_script_6.A, FragmentD="%")
hud_pie = DrawPieChart(BoundaryRectangle=rec, Labels=concat, DataValues=c_script_6.A, ColorPalette=palette)
hud = HeadsUpDisplayHUD(
    ShowHUD=Toggle(True),
    DrawingObjects=hud_pie,
    DrawingBoundary=rec_2,
    ConduitStyleSheet="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")
line = Line(generativebuilding.ShearWallLines)
line_2 = Line(generativebuilding.CorridorLines)
c_script_7 = CSharpScript(x=generativebuilding.UnitNames)  # -> A; inputs x: String
# ---------- c_script_7: C# ----------
    if(x == "S")
    {
      A = "40,40,40";
    }
    if(x == "A")
    {
      A = "70,70,70";
    }
    if(x == "B")
    {
      A = "110,110,110";
    }
    if(x == "C")
    {
      A = "150,150,150";
    }
# ---------- end c_script_7 ----------
pipe = Pipe(Curve=[line, line_2], Radius=Slider(8, range=0..10), Caps=0)
srf = Surface(generativebuilding.Units)
preview = CustomPreview(Geometry=pipe, Material=ColourSwatch(SwatchColor=RGB(255, 0, 0)))
preview_2 = CustomPreview(Geometry=srf, Material=c_script_7)
